# Grasshopper definition FLOOR SPACE.gh (Grasshopper 0.9.75)

crv = Curve([<curve referenced from the Rhino model> x254])
crv_2 = Curve([<curve referenced from the Rhino model> x76])
crv_3 = Curve([<curve referenced from the Rhino model> x94])
crv_4 = Curve([<curve referenced from the Rhino model> x364])
crv_5 = Curve([<curve referenced from the Rhino model> x90])
crv_6 = Curve([<curve referenced from the Rhino model> x110])
crv_7 = Curve([<curve referenced from the Rhino model> x113])
crv_8 = Curve([<curve referenced from the Rhino model> x116])
crv_9 = Curve([<curve referenced from the Rhino model> x98])
crv_10 = Curve([<curve referenced from the Rhino model> x181])
crv_11 = Curve([<curve referenced from the Rhino model> x766])
crv_12 = Curve([<curve referenced from the Rhino model> x20])
crv_13 = Curve([<curve referenced from the Rhino model> x25])
crv_14 = Curve([<curve referenced from the Rhino model> x98])
crv_15 = Curve([<curve referenced from the Rhino model> x346])
crv_16 = Curve([<curve referenced from the Rhino model> x110])
crv_17 = Curve([<curve referenced from the Rhino model> x347])
crv_18 = Curve([<curve referenced from the Rhino model> x119])
crv_19 = Curve([<curve referenced from the Rhino model> x82])
crv_20 = Curve([<curve referenced from the Rhino model> x119])
crv_21 = Curve([<curve referenced from the Rhino model> x20])
crv_22 = Curve([<curve referenced from the Rhino model> x25])
end = EndPoints(Curve=crv)  # -> Start, End
end_2 = EndPoints(Curve=crv_2)  # -> Start, End
end_3 = EndPoints(Curve=crv_3)  # -> Start, End
end_4 = EndPoints(Curve=crv_4)  # -> Start, End
end_5 = EndPoints(Curve=crv_5)  # -> Start, End
divide = DivideCurve(Curve=crv_8, Count=10, Kinks=False)  # -> Points, Tangents, Parameters
end_6 = EndPoints(Curve=crv_6)  # -> Start, End
end_7 = EndPoints(Curve=crv_7)  # -> Start, End
end_8 = EndPoints(Curve=crv_10)  # -> Start, End
end_9 = EndPoints(Curve=crv_12)  # -> Start, End
end_10 = EndPoints(Curve=crv_13)  # -> Start, End
end_11 = EndPoints(Curve=crv_9)  # -> Start, End
end_12 = EndPoints(Curve=crv_11)  # -> Start, End
end_13 = EndPoints(Curve=crv_14)  # -> Start, End
end_14 = EndPoints(Curve=crv_15)  # -> Start, End
end_15 = EndPoints(Curve=crv_16)  # -> Start, End
end_16 = EndPoints(Curve=crv_17)  # -> Start, End
end_17 = EndPoints(Curve=crv_18)  # -> Start, End
end_18 = EndPoints(Curve=crv_20)  # -> Start, End
end_19 = EndPoints(Curve=crv_21)  # -> Start, End
end_20 = EndPoints(Curve=crv_22)  # -> Start, End
end_21 = EndPoints(Curve=crv_19)  # -> Start, End
hull = ConvexHull(Points=[end.Start, end.End], Plane=PlaneXY(0, 0, 0))  # -> Hull, HullZ, Indices
hull_2 = ConvexHull(Points=[end_2.Start, end_2.End], Plane=PlaneXY(0, 0, 0))  # -> Hull, HullZ, Indices
hull_3 = ConvexHull(Points=[end_3.Start, end_3.End], Plane=PlaneXY(0, 0, 0))  # -> Hull, HullZ, Indices
hull_4 = ConvexHull(Points=[end_4.Start, end_4.End], Plane=PlaneXY(0, 0, 0))  # -> Hull, HullZ, Indices
hull_5 = ConvexHull(Points=[end_5.Start, end_5.End], Plane=PlaneXY(0, 0, 0))  # -> Hull, HullZ, Indices
hull_6 = ConvexHull(Points=[end_6.Start, end_6.End], Plane=PlaneXY(0, 0, 0))  # -> Hull, HullZ, Indices
hull_7 = ConvexHull(Points=[end_7.Start, end_7.End], Plane=PlaneXY(0, 0, 0))  # -> Hull, HullZ, Indices
hull_8 = ConvexHull(Points=divide.Points, Plane=PlaneXY(0, 0, 0))  # -> Hull, HullZ, Indices
hull_9 = ConvexHull(Points=[end_8.Start, end_8.End], Plane=PlaneXY(0, 0, 0))  # -> Hull, HullZ, Indices
hull_10 = ConvexHull(Points=[end_9.Start, end_9.End], Plane=PlaneXY(0, 0, 0))  # -> Hull, HullZ, Indices
hull_11 = ConvexHull(Points=[end_10.Start, end_10.End], Plane=PlaneXY(0, 0, 0))  # -> Hull, HullZ, Indices
hull_12 = ConvexHull(Points=[end_11.Start, end_11.End], Plane=PlaneXY(0, 0, 0))  # -> Hull, HullZ, Indices
hull_13 = ConvexHull(Points=[end_12.Start, end_12.End], Plane=PlaneXY(0, 0, 0))  # -> Hull, HullZ, Indices
hull_14 = ConvexHull(Points=[end_13.Start, end_13.End], Plane=PlaneXY(0, 0, 0))  # -> Hull, HullZ, Indices
hull_15 = ConvexHull(Points=[end_14.Start, end_14.End], Plane=PlaneXY(0, 0, 0))  # -> Hull, HullZ, Indices
hull_16 = ConvexHull(Points=[end_15.Start, end_15.End], Plane=PlaneXY(0, 0, 0))  # -> Hull, HullZ, Indices
hull_17 = ConvexHull(Points=[end_16.Start, end_16.End], Plane=PlaneXY(0, 0, 0))  # -> Hull, HullZ, Indices
hull_18 = ConvexHull(Points=[end_17.Start, end_17.End], Plane=PlaneXY(0, 0, 0))  # -> Hull, HullZ, Indices
hull_19 = ConvexHull(Points=[end_18.Start, end_18.End], Plane=PlaneXY(0, 0, 0))  # -> Hull, HullZ, Indices
hull_20 = ConvexHull(Points=[end_19.Start, end_19.End], Plane=PlaneXY(0, 0, 0))  # -> Hull, HullZ, Indices
hull_21 = ConvexHull(Points=[end_20.Start, end_20.End], Plane=PlaneXY(0, 0, 0))  # -> Hull, HullZ, Indices
hull_22 = ConvexHull(Points=[end_21.Start, end_21.End], Plane=PlaneXY(0, 0, 0))  # -> Hull, HullZ, Indices
join = JoinCurves(
    Curves=[hull_3.Hull, hull_2.Hull, hull.Hull, hull_4.Hull, hull_7.Hull, hull_6.Hull, hull_5.Hull, hull_13.Hull, hull_9.Hull, hull_10.Hull, hull_11.Hull, hull_14.Hull, hull_12.Hull, hull_8.Hull, hull_15.Hull, hull_18.Hull, hull_17.Hull, hull_16.Hull, hull_22.Hull, hull_19.Hull],
    Preserve=False)
crv_23 = Curve([<curve referenced from the Rhino model> x24])
boundary = BoundarySurfaces(Edges=join)
boundary_2 = BoundarySurfaces(Edges=crv_23)
outer_boundary = Curve(<curve referenced from the Rhino model>)
join_2 = JoinCurves(Curves=[boundary, boundary_2], Preserve=False)
boundary_3 = BoundarySurfaces(Edges=outer_boundary)
boundary_4 = BoundarySurfaces(Edges=join_2)
rdiff = RegionDifference(CurvesA=outer_boundary, CurvesB=boundary)
boundary_5 = BoundarySurfaces(Edges=rdiff)
