# Grasshopper definition 01_Isovist_basestationLayout.gh (Grasshopper 0.9.76)
# plug-ins: Python Interpreter

# ---- group: Basestation XY Coords
arup_basestation_points = Point([<point referenced from the Rhino model> x37])
bvn_basestation_points = Point([<point referenced from the Rhino model> x40])
sphere = Sphere(Base=bvn_basestation_points, Radius=Slider(547, range=0..1000))

# ----
# Sorting Basestation based on Closest Curve
names = Panel("""Ace
Alfa
Beer
Bravo
Charlie
Coco
Dee
Delta
Echo
Edward
Foxtrot
Freddie
George
Golf
Harry
Hotel
India
Ink
Johnnie
Juliett
Kilo
King
Lima
London
Mike
Monkey
November
Nuts
Orange
Oscar
Papa
Pip
Quebec
Queen
Robert
Romeo
Sierra
Sugar
Tango
Tick
Uncle
Uniform
Vic
Victor
Whisky
William
X-ray
X-men
Yankee
Yorker
Zebra
Zulu""")
curve = Curve(reparameterize(<curve referenced from the Rhino model>))
point = Point(bvn_basestation_points)
sort_along_curve = SortAlongCurve(values_a=point, curve=curve)  # -> docs_2, sorted_points_2
cluster = Cluster(source_list=point, target_list=names)
text_tag_3d = TextTag3D(Location=sort_along_curve.sorted_points_2, Text=cluster, Size=Slider(1001, range=0..10000), Justification=7)
sorted_points = Point(sort_along_curve.sorted_points_2)

# ----
# Use before turning on Python Script
number_slider = Slider(5000, range=0..10000)
circle_cnr = CircleCNR(Center=bvn_basestation_points, Normal=Vector(0, 0, 1), Radius=number_slider)
surface = Surface(circle_cnr)

# ---- group: Isovist
# Isovist Python (takes a while to compute if enabled)
number_slider_2 = Slider(1000, range=0..1000)
pipeline = GeometryPipeline(
    GroupByLayer=False,
    GroupByType=False,
    IncludeHidden=True,
    IncludeLocked=True,
    LayerFilter="_gh_boundary_isovist_ARUP",
    NameFilter="*",
    TypeFilter=4)
pipeline_2 = GeometryPipeline(
    GroupByLayer=False,
    GroupByType=False,
    IncludeHidden=True,
    IncludeLocked=True,
    LayerFilter="_gh_boundary_isovist_BVN",
    NameFilter="*",
    TypeFilter=4)
python = PythonScript(points=bvn_basestation_points, lines=number_slider_2, radius=Slider(5000, range=0..10000), boundries=pipeline_2)  # -> pointOut, totalIsovist, isovistsClear, overlapSpace, isovistsList, isovistTotalSurface, nonOverlapSpace; inputs points: list of Point3d, lines: Int32, radius: Int32, boundries: list
# ---------- python: Python ----------
import ghpythonlib.components as ghcomp
import rhinoscriptsyntax as rs
import Rhino.Geometry as rg




isovistsList = []
overlapSpaceList = []
isovistsClear = []
pointOut = points

for point in points:
    isovists = ghcomp.IsoVist(point,lines,radius,boundries)
    getIsovistPoints=isovists[0]
    isovistsOutline = ghcomp.PolyLine(getIsovistPoints,True)
    makeSurface = ghcomp.BoundarySurfaces(isovistsOutline)
    print makeSurface
    isovistsList.append(makeSurface)

coerceBrepList = []

for individualIsovists in isovistsList:
    coercedOneBrep = rs.coercebrep(individualIsovists)
    coerceBrepList.append(coercedOneBrep)

isovistCoercedUnion = ghcomp.RegionUnion(coerceBrepList)
isovistTotalSurface = ghcomp.BoundarySurfaces(isovistCoercedUnion)

interA = isovistsList[0:len(isovistsList)-1]
interB = isovistsList[1:]

for itsA in interA:
    for itsB in interB:
        if itsA == itsB:
            print itsA
        else:
            regionInter = ghcomp.RegionIntersection(itsA,itsB)
            surfaceInter = ghcomp.BoundarySurfaces(regionInter)
            #if len(surfaceInter) != 1:
            #    for listList in surfaceInter:
            #        print listList
            #        overlapSpaceList.append(listList)
            overlapSpaceList.append(surfaceInter)


flatOver = []

for testList in overlapSpaceList:
    testIfList = isinstance(testList, list)
    if testIfList == True:
        for isList in testList:
            flatOver.append(isList)
    else:
        flatOver.append(testList)

overlapSpace = flatOver

##asd = []

##overlapSpace = ghcomp.RegionUnion(flatOver)

##for getnotOverlapSpace in isovistsList:
##    pineapple = ghcomp.RegionDifference(getnotOverlapSpace, overlapSpace)
##    asd.append(pineapple)
##nonOverlapSpace = asd


#overlapCombination = ghcomp.RegionUnion(flatOver)
#print overlapCombination
#overlapSurface = ghcomp.BoundarySurfaces(overlapCombination)
#overlapCalcArea = ghcomp.Area(overlapSurface)
#print overlapCalcArea


#for overlapPiece in overlapCalcArea[0]:
#    overlapArea = overlapArea + overlapPiece

#print overlapSpaceList
#overlapSpace = flatOver



#ghcomp.regi

#a = isovistsList
# ---------- end python ----------
srf = Surface(python.isovistTotalSurface)  # disabled
runion = RegionUnion()
crv = Curve([<curve referenced from the Rhino model> x2])
boundary = BoundarySurfaces(Edges=runion)
debrep = DeconstructBrep(Brep=srf)  # -> Faces, Edges, Vertices
area = Area(Geometry=srf)  # -> Area, Centroid
runion_2 = RegionUnion(Curves=crv)
area_2 = Area(Geometry=boundary)  # -> Area, Centroid
ma = MassAddition(Input=area.Area)  # -> Result, PartialResults
boundary_2 = BoundarySurfaces(Edges=runion_2)
ma_2 = MassAddition(Input=area_2.Area)  # -> Result, PartialResults
area_3 = Area(Geometry=boundary_2)  # -> Area, Centroid
subtraction = Subtraction(A=area_3.Area, B=ma.Result)
division = Division(A=subtraction, B=area_3.Area)
multiplication = Multiplication(A=division, B=100)
data = Data(simplify(graft(["Units Squared", "Percentage (%)"])))
data_2 = Data(simplify(graft([subtraction, multiplication])))
total_area = Panel(area_3.Area)
area_not_covered = Panel([data, data_2])
overlap_area = Panel(ma_2.Result)
area_covered = Panel(ma.Result)

# ---- group: Basestation XY Coords (continued)
basestation_xy = Deconstruct(Point=sorted_points)  # -> XComponent, YComponent, ZComponent
panel = Panel(basestation_xy.YComponent)
panel_2 = Panel(basestation_xy.XComponent)

# ==== cluster SortAlongCurve
values_a = ClusterInput()
curve = ClusterInput()
curve_closest_point = CurveClosestPoint(Points=values_a, Curve=curve)  # -> Point, Parameter, Distance
panel = Panel("this takes a curve and list of points. It sorts the points by their t along that curve (by CP)")
sort_list = SortList(Keys=curve_closest_point.Parameter, ValuesValuesA=values_a)  # -> Keys, ValuesValuesA
sorted_points = Point(sort_list.ValuesValuesA)
docs = Text(panel)
docs_2 = ClusterOutput(docs)
sorted_points_2 = ClusterOutput(sorted_points)

# ==== cluster Cluster
source_list = ClusterInput()
list_length = ListLength(SourceList=source_list)
target_list = ClusterInput()
construct_domain = ConstructDomain(DomainStart=0, DomainEnd=expr("x-1", list_length))
sub_list = SubList(TargetList=target_list, Domain=construct_domain, Wrap=False)  # -> List, Index
list = ClusterOutput(sub_list.List)
