# Grasshopper definition lasercut.gh (Grasshopper 0.9.76)

beacon_radius = Slider(26.5, range=0..100)
number_slider = Slider(22, range=0..100)
beacon_radius_2 = Slider(26.5, range=0..100)
origin_of_beacon = ConstructPoint(XCoordinate=0, YCoordinate=0, ZCoordinate=0)
unit_y = UnitY(Factor=1)
construct_point = ConstructPoint(XCoordinate=beacon_radius_2, YCoordinate=0, ZCoordinate=0)
circle = Circle(Plane=PlaneXY(0, 0, 0), Radius=beacon_radius_2)
unit_y_2 = UnitY(Factor=expr("2*x", beacon_radius_2))
beacon = CircleCNR(Center=origin_of_beacon, Normal=Vector(0, 0, 1), Radius=beacon_radius)
srf = Surface(beacon)
number_of_segments = DivideCurve(Curve=beacon, Count=number_slider, Kinks=False)  # -> Points, Tangents, Parameters
line_sdl = LineSDL(Start=construct_point, Direction=unit_y, Length=100)
unit_y_3 = UnitY(Factor=Slider(28.593, range=20..30))
move = Move(Geometry=circle, Motion=unit_y_2)  # -> Geometry, Transform
move_2 = Move(Geometry=line_sdl, Motion=unit_y_3)  # -> Geometry, Transform
number_slider_2 = Slider(3, range=0..10)
number_slider_3 = Slider(8, range=0..100)
xy_plane = XYPlane(Origin=Point(0, 0, 0))
line = Line(StartPoint=origin_of_beacon, EndPoint=number_of_segments.Points)
tabs = CircleCNR(Center=number_of_segments.Points, Normal=Vector(0, 0, 1), Radius=Slider(9, range=0..10))
circle_tantan = CircleTanTan(CurveA=move.Geometry, CurveB=move_2.Geometry, Point=xy_plane)
radius_string_hole = Slider(2.5, range=0..10)
extend_curve = ExtendCurve(Curve=line, Type=0, Start=number_of_segments.Points, End=number_slider)
isolate_tabs = ListItem(List=tabs, Index=[number_slider_3, number_slider_2], Wrap=True)
area = Area(Geometry=circle_tantan)  # -> Area, Centroid
srf_2 = Surface(isolate_tabs)
point_on_curve = PointOnCurve(extend_curve, parameter=0.756)
radius_of_hole = Slider(2.5, range=0..10)

# ---- group: string hole
circle_2 = Circle(Plane=area.Centroid, Radius=radius_string_hole)

# ----
isolate_tabs_2 = ListItem(List=point_on_curve, Index=[number_slider_2, number_slider_3], Wrap=True)
curve_line = CurveLine(Curve=circle_tantan, Line=line_sdl)  # -> Points, Params, Count
region_difference = RegionDifference(CurvesA=srf_2, CurvesB=srf)
hole = CircleCNR(Center=isolate_tabs_2, Normal=Vector(0, 0, 1), Radius=Slider(6, range=0..10))
hole_2 = CircleCNR(Center=isolate_tabs_2, Normal=Vector(0, 0, 1), Radius=radius_of_hole)
line_2 = Line(StartPoint=construct_point, EndPoint=curve_line.Points)
region_difference_2 = RegionDifference(CurvesA=hole, CurvesB=beacon)
join_curves = JoinCurves(Curves=[region_difference, hole_2, beacon], Preserve=False)
merge = Merge(Data1=circle_tantan, Data2=circle_2, Data3=circle, Data4=move.Geometry, Data5=line_2)
number_slider_4 = Slider(600, range=0..1000)
number_slider_5 = Slider(900, range=0..1000)
construct_point_2 = ConstructPoint(XCoordinate=number_slider_5, YCoordinate=number_slider_4, ZCoordinate=0)
construct_point_3 = ConstructPoint(XCoordinate=0, YCoordinate=0, ZCoordinate=0)
box_2pt = Box2Pt(PointA=construct_point_3, PointB=construct_point_2, Plane=PlaneXY(0, 0, 0))
number_slider_6 = Slider(4, range=-20..20)
deconstruct_brep = DeconstructBrep(Brep=box_2pt)  # -> Faces, Edges, Vertices
number_slider_7 = Slider(53, range=0..100)
number_slider_8 = Slider(53, range=0..100)
curve = Curve(deconstruct_brep.Edges)
negative = Negative(Value=number_slider_6)
division = Division(A=number_slider_5, B=number_slider_8)
division_2 = Division(A=number_slider_4, B=number_slider_7)
offset_loose = OffsetLoose(Curve=curve, Distance=negative)
round = Round(Number=division)  # -> Nearest, Floor, Ceiling
round_2 = Round(Number=division_2)  # -> Nearest, Floor, Ceiling
construct_point_4 = ConstructPoint(XCoordinate=number_slider_6, YCoordinate=number_slider_6, ZCoordinate=0)
rectangular = Rectangular(Plane=construct_point_4, SizeX=number_slider_8, SizeY=number_slider_7, ExtentX=round.Floor, ExtentY=round_2.Floor)  # -> Cells, Points
bunny_ears = Curve([<curve referenced from the Rhino model> x4])
area_2 = Area(Geometry=rectangular.Cells)  # -> Area, Centroid
boundary_surfaces = BoundarySurfaces(Edges=bunny_ears)
panel = Panel("""Annisa Rivera Rizal
Alex Lee
Tiara Dobs
Ben Doherty
Ninotschka Titchkosky""")
move_3 = Move(Geometry=boundary_surfaces, Motion=area_2.Centroid)  # -> Geometry, Transform
case = TextCase(Text=panel, Culture=127)  # -> UpperCase, LowerCase
circle_cnr = CircleCNR(Center=area_2.Centroid, Normal=Vector(0, 0, 1), Radius=Slider(19.31, range=0..100))
characters = Characters(Text=case.UpperCase)  # -> Result, Unicode
characters_2 = Characters(Text="WHERE-IN.SPACE")  # -> Result, Unicode
list_length = ListLength(List=characters.Result)  # -> expr("x-1", Length)
deconstruct_brep_2 = DeconstructBrep(Brep=move_3.Geometry)  # -> Faces, Edges, Vertices
divide_curve = DivideCurve(Curve=circle_cnr, Count=Slider(12, range=0..20), Kinks=False)  # -> Points, Tangents, Parameters
list_length_2 = ListLength(List=characters_2.Result)  # -> expr("x-1", Length)
curve_2 = Curve(deconstruct_brep_2.Edges)
list_item = ListItem(List=divide_curve.Points, Index=Slider(7, range=0..100), Wrap=True)
list_item_2 = ListItem(List=divide_curve.Points, Index=Slider(9, range=0..100), Wrap=True)
list_item_3 = ListItem(List=divide_curve.Points, Index=Slider(11, range=0..100), Wrap=True)
list_item_4 = ListItem(List=divide_curve.Points, Index=Slider(5, range=0..100), Wrap=True)
list_item_5 = ListItem(List=divide_curve.Points, Index=Slider(3, range=0..100), Wrap=True)
list_item_6 = ListItem(List=divide_curve.Points, Index=Slider(1, range=0..100), Wrap=True)
arc_3pt = Arc3Pt(PointA=list_item_4, PointB=list_item_5, PointC=list_item_6)  # -> Arc, Plane, Radius
arc_3pt_2 = Arc3Pt(PointA=list_item, PointB=list_item_2, PointC=list_item_3)  # -> flatten(Arc), Plane, Radius
horizontal_frames = HorizontalFrames(Curve=arc_3pt_2.Arc, Count=list_length_2)  # -> Frames, Parameters
horizontal_frames_2 = HorizontalFrames(Curve=arc_3pt.Arc, Count=list_length)  # -> Frames, Parameters
text_tag_3d = TextTag3D(
    Location=horizontal_frames.Frames,
    Text=characters_2.Result,
    Size=Slider(2.5, range=1..4),
    Colour=ColourSwatch(SwatchColor=RGB(0, 0, 255)),
    Justification=8)
text_tag_3d_2 = TextTag3D(
    Location=horizontal_frames_2.Frames,
    Text=characters.Result,
    Size=Slider(1, range=0..100),
    Colour=ColourSwatch(SwatchColor=RGB(0, 0, 255)),
    Justification=7)
