# Grasshopper definition gh-python-json-name-coordinant-reader1.gh (Grasshopper 0.9.76)
# plug-ins: Python Interpreter

panel = Panel("""Alpha
Bravo""")
path = FilePath("F:\InfoTech\ARIVERA - DO NOT REMOVE\BlankMindBlog\helpers\baseStations_BVN_NEW.json")
path_2 = FilePath("F:\InfoTech\ARIVERA - DO NOT REMOVE\BlankMindBlog\helpers\experiments\exp8\reformatted\threemetre_exp8.json")
json = PythonScript(FilePath=path, inputName=panel)  # -> out, x, y
# ---------- json: Python ----------
import json

if FilePath:
    
    # JSON file to read
    file = open(FilePath)
    
    # Load the data
    data = json.load(file)
    
    # Do something with the data
    for basestation in data:
        print basestation["Name"]
        print inputName
        if basestation["Name"] == inputName:
            x = basestation["X"]
            y = basestation["Y"]
            print x
            print y
# ---------- end json ----------
json_2 = PythonScript(FilePath=path_2, uuid="d0d3fa86ca7645ec9bd96af400000005")  # -> out, x, y
# ---------- json_2: Python ----------
import json

if FilePath:
    
    # JSON file to read
    file = open(FilePath)
    
    # Load the data
    data = json.load(file)
    
    # Do something with the data
    for basestation in data:
        print basestation["Name"]
        print uuid
        if basestation["Name"] == inputName:
            x = basestation["X"]
            y = basestation["Y"]
            print x
            print y
# ---------- end json_2 ----------
panel_2 = Panel(json.y)
panel_3 = Panel(json.x)
