# Grasshopper definition gh-python-json-name-coordinant-reader1.gh (Grasshopper 0.9.75)
# plug-ins: Python Interpreter

panel = Panel("""Alpha
Bravo
Kilo""")
panel_2 = Panel("""annisa
alex
tiara""")
path = FilePath("F:\BlankMindBlog\helpers\gh_visualisation\json_basestation\baseStations_BVN_NEW.json")
path_2 = FilePath("F:\BlankMindBlog\helpers\gh_visualisation\json_detection data\fakedata.json")
data_json = PythonScript(FilePath=path, inputName=panel)  # -> out, x, y
# ---------- data_json: Python ----------
import json

if FilePath:
    
    # JSON file to read
    file = open(FilePath)
    
    # Load the data
    data = json.load(file)
    
    # Do something with the data
    for basestation in data:
        print basestation["Name"]
        print inputName
        if basestation["Name"] == inputName:
            x = basestation["X"]
            y = basestation["Y"]
            print x
            print y
# ---------- end data_json ----------
detections_json = PythonScript(FilePath=path_2, name=panel_2)  # -> detections
# ---------- detections_json: Python ----------
import json
import rhinoscriptsyntax as rs

if FilePath:
    
    # JSON file to read
    file = open(FilePath)
    
    # Load the data
    detections = json.load(file)
    
    for person in detections:
        if person["name"] == name:
            time = person["time"]
            basestation = person["basestation"]
            print basestation
            
            #detections.append({"time": time, "basestation" : basestation })
            
            #print "Time:" + time, "BS:" + basestation
            
     if basestation in detections == basestation in data:
         rs.AddPoint(x,y)
# ---------- end detections_json ----------
panel_3 = Panel(detections_json)
panel_4 = Panel(data_json.x)
panel_5 = Panel(data_json.y)
json = PythonScript(FilePath=path_2, name=panel_2)  # -> detections
# ---------- json: Python ----------
import json

if FilePath:
    
    # JSON file to read
    file = open(FilePath)
    
    # Load the data
    data = json.load(file)
    
    for person in data:
        if person["name"] == name:
            time = person["time"]
            basestation = person["basestation"]
            
            #detections.append({"time": time, "basestation" : basestation })
            
            print "Time:" + time, "BS:" + basestation
# ---------- end json ----------
construct_point = ConstructPoint(XCoordinate=panel_4, YCoordinate=panel_5, ZCoordinate=0)
