# Grasshopper definition 04_BasestationToBasestation.gh (Grasshopper 0.9.75)
# plug-ins: Python Interpreter, Shortest Walk in Gh

# ----
# Names/UUID
# This gets all the unique names. Because it's using toy data we can use names. On the real data we'd need to use UUIDs.
windows_samplerealdata = FilePath("F:\BlankMindBlog\helpers\gh_visualisation\json_detection data\dumpdata.json")
windows_fakedata = FilePath("F:\BlankMindBlog\helpers\gh_visualisation\json_detection data\fakedata.json")
linuxpath = FilePath("\\VBOXSVR\projects\tuksun\BlankMindBlog\helpers\gh_visualisation\json_detection data\fakedata.json")
panel = Panel(windows_fakedata)
names = PythonScript(FilePath=windows_samplerealdata)  # -> flatten(uuids)
# ---------- names: Python ----------
import json

if FilePath:
    
    # JSON file to read
    file = open(FilePath)
    
    # Load the data
    data = json.load(file)
    
    uuids = []
    
    for d in data:
        uuids.append( d['uuid'] )
    
    print uuids
# ---------- end names ----------
names_2 = PythonScript(FilePath=windows_fakedata)  # -> flatten(names)
# ---------- names_2: Python ----------
import json

if FilePath:
    
    # JSON file to read
    file = open(FilePath)
    
    # Load the data
    data = json.load(file)
    
    names = []
    
    for d in data:
        names.append( d['name'] )
    
    print names
# ---------- end names_2 ----------
cset = CreateSet(List=names_2)  # -> Set, Map
cset_2 = CreateSet(List=names)  # -> Set, Map
panel_2 = Panel(cset.Set)
panel_3 = Panel(cset_2.Set)

windows_samplerealdata_2 = FilePath("F:\BlankMindBlog\helpers\gh_visualisation\json_detection data\dumpdata.json")
names_3 = PythonScript(FilePath=windows_samplerealdata_2)  # -> uuids, a
# ---------- names_3: Python ----------
import json

if FilePath:
    
    # JSON file to read
    file = open(FilePath)
    
    # Load the data
    data = json.load(file)
    
    uuids = []
    
    for d in data:
        uuids.append( d['major'] )
    
    print uuids
# ---------- end names_3 ----------
cset_3 = CreateSet(List=names_3.uuids)  # -> Set, Map
panel_4 = Panel(cset_3.Set)

# ----
# Basestations
# This draws out the points that corespond to the base stations.
# I've cheated and put in a static list of base stations instead of reading it froma file. This is for laziness and for performance (that list doesn't change much).
arup_basestations = Panel("""RPI001
RPI002
RPI003
RPI004
RPI005
RPI006
RPI007
RPI008
RPI009
RPI010
RPI011
RPI012
RPI013
RPI014
RPI015
RPI016
RPI017
RPI018
RPI019
RPI020
RPI021
RPI022
RPI023
RPI024
RPI025
RPI026
RPI027
RPI028
RPI029
RPI030
RPI031
RPI032
RPI033
RPI034
RPI035
RPI036
RPI037""")
bvn_basestations = Panel("""RPI004
RPI005
RPI006
RPI007
RPI008
RPI009
RPI010
RPI011
RPI012
RPI013
RPI014
RPI015
RPI016
RPI017
RPI018
RPI019
RPI020
RPI021
RPI022
RPI023
RPI024
RPI025
RPI026
RPI027
RPI028
RPI029
RPI030
RPI031
RPI032
RPI033
RPI034
RPI035
RPI036
RPI037
RPI038
RPI039
RPI040
RPI041
RPI042""")
arup_path = FilePath("F:\BlankMindBlog\helpers\basestation_location\baseStations_ARUP.json")
bvn_path = FilePath("F:\BlankMindBlog\helpers\basestation_location\baseStations_BVN.json")
list_of_basestations = ListOfBasestations(filepath=bvn_path, inputname=bvn_basestations)  # -> x, y
x_y_coords = ConstructPoint(XCoordinate=list_of_basestations.x, YCoordinate=list_of_basestations.y, ZCoordinate=0)
tag = TextTag3D(Location=x_y_coords, Text=arup_basestations, Size=1562, Colour=RGB(3, 217, 255), Justification=5)
panel_5 = Panel(list_of_basestations.x)
panel_6 = Panel(list_of_basestations.y)

# ----
# Detections
# Given a list of names, this finds all the detections related to each of those names and returns them as a list of lists.
json_detections = PythonScript(FilePath=windows_fakedata, name=cset.Set)  # -> data, base, time
# ---------- json_detections: Python ----------
import json

if FilePath:
    
    # JSON file to read
    file = open(FilePath)
    
    # Load the data
    detections = json.load(file)
    data = str(detections)
    
    time = []
    base = []
    
    for detection in detections:
        if detection["name"] == name:
            print detection
            time.append( detection["time"] )
            base.append( detection["basestation"] )
# ---------- end json_detections ----------
json_detections_2 = PythonScript(FilePath=windows_samplerealdata, uuid=panel_3)  # -> agent, time
# ---------- json_detections_2: Python ----------
import json

if FilePath:
    
    # JSON file to read
    file = open(FilePath)
    
    # Load the data
    detections = json.load(file)
    #data = str(detections)
    
    time = []
    agent = []
    
    for d in detections:
        if d['uuid'] == uuid:
            print detection
            time.append( d['time'] )
            agent.append( d['agentId'] )
# ---------- end json_detections_2 ----------
cset_4 = CreateSet(List=json_detections_2.agent)  # -> Set, Map
panel_7 = Panel(json_detections_2.time)
panel_8 = Panel(json_detections.base)
panel_9 = Panel(json_detections.time)
panel_10 = Panel(json_detections_2.agent)
panel_11 = Panel(cset_4.Set)

split = TextSplit(Text=panel_7)

# ----
# This maps the points so that the path is continous e.g. [0] to [1], [1] to [2]....
joining_curves = PythonScript(base=json_detections_2.agent)  # -> start, end; inputs base: list
# ---------- joining_curves: Python ----------
import ghpythonlib as gh

x = 0
start = []
end = []

while x < len(basestations)-1:
    start.append(basestations[x])
    end.append(basestations[x + 1])
    x = x + 1
    
    print start
    print end
# ---------- end joining_curves ----------
panel_12 = Panel(joining_curves.start)
panel_13 = Panel(joining_curves.end)

# ----
# This takes list of detections and
# returns the x, y coords of the basestations
# Start and End Pts
number_slider = Slider(313, range=0..1000)
detection_of_end_point = ListOfBasestations(filepath=bvn_path, inputname=panel_13)  # -> x, y
detection_of_start_point = ListOfBasestations(filepath=bvn_path, inputname=panel_12)  # -> x, y
end_pts = ConstructPoint(XCoordinate=detection_of_end_point.x, YCoordinate=detection_of_end_point.y, ZCoordinate=0)
start_pts = ConstructPoint(XCoordinate=detection_of_start_point.x, YCoordinate=detection_of_start_point.y, ZCoordinate=0)
panel_14 = Panel(end_pts)
panel_15 = Panel(start_pts)
sphere = Sphere(Base=[start_pts, end_pts], Radius=number_slider)

# ----
# Direct Path
# What the path should be without the obstacles
ln = Line(PointA=panel_15, PointB=panel_14)

pipe = Pipe(Curve=ln, Radius=Slider(72, range=0..100), Caps=0)

# ----
# Obstacles and Nav Mesh BVN
pipeline = GeometryPipeline(
    GroupByLayer=False,
    GroupByType=False,
    IncludeHidden=True,
    IncludeLocked=True,
    LayerFilter="_gh_nav_graph_BVN",
    NameFilter="*",
    TypeFilter=4)
dam = DataDam(DataA=pipeline, BufferDelay=10000000, BufferMode=0)
geometry = Geometry(dam)

# ----
# shortest walk/ simulated data
shortest_walk = ShortestWalk(Curves=dam, WantedPath=ln)  # -> ShortestWalk, Succession, Direction, Length
curvepoint = PointOnCurve(shortest_walk.ShortestWalk, parameter=0)
msphere = MeshSphere(Base=curvepoint, Radius=1000, UCount=5, VCount=4)
tag_2 = TextTag3D(Location=curvepoint, Text=graft(cset.Set), Size=Slider(1297, range=0..5000), Colour=RGB(255, 0, 0), Justification=7)

pipe_2 = Pipe(Curve=shortest_walk.ShortestWalk, Radius=Slider(80, range=0..100), Caps=0)

# ----
# Checkpoints
eval = EvaluateLength(Curve=shortest_walk.ShortestWalk, Length=[0, 1], Normalized=True)  # -> Point, Tangent, Parameter
Z = UnitZ(Factor=1)
box = CenterBox(Base=eval.Point, X=0.1, Y=0.1, Z=0.07)
xprod = CrossProduct(VectorA=Z, VectorB=eval.Tangent, Unitize=False)  # -> Vector, Length
pl = Plane(Origin=eval.Point, XAxis=xprod.Vector, YAxis=Z)
T = Text(["START", "GOAL"])
tag_3 = TextTag(Location=pl, Text=T)

# ----
# Vectors Along Path
item = ListItem(List=geometry, Index=shortest_walk.Succession, Wrap=False)
end = EndPoints(Curve=item)  # -> Start, End
vec2pt = Vector2Pt(PointA=end.Start, PointB=end.End, Unitize=False)  # -> Vector, Length
eval_2 = EvaluateLength(Curve=item, Length=0.5, Normalized=True)  # -> Point, Tangent, Parameter
remap = RemapNumbers(Values=shortest_walk.Direction, Source=Domain(0, 1), Target=Domain(-0.1, 0.1))
amp = Amplitude(Vector=vec2pt.Vector, Amplitude=remap)
vdis = VectorDisplay(Anchor=eval_2.Point, Vector=amp)

# ==== cluster ListOfBasestations
inputname = ClusterInput()
filepath = ClusterInput()
data_json = PythonScript(FilePath=filepath, inputName=inputname)  # -> out, x, y
# ---------- data_json: Python ----------
import json

if FilePath:
    
    # JSON file to read
    file = open(FilePath)
    
    # Load the data
    data = json.load(file)
    
    # Do something with the data
    for basestation in data:
        print basestation["Name"]
#        print inputName
        if basestation["Name"] == inputName:
            x = basestation["X"]
            y = basestation["Y"]
            print x
            print y
# ---------- end data_json ----------
y = ClusterOutput(data_json.y)
x = ClusterOutput(data_json.x)
