# Grasshopper definition prototype006.gh (Grasshopper 0.9.76)

# ---- group: base plug controls
through_cut = Slider(11, range=0..15)
# Base plug
baseplugheight = Slider(20, range=0..100)
pi_recess_depth = Slider(18, range=0..100)

# ----
post_outside_rad = Slider(11.25, range=0..12.5)
pole_length = Slider(-460, range=-1000..1001)
post_inside_rad = Slider(10, range=-1..11)
top_of_the_pole = Point(<point referenced from the Rhino model>)
cir = Circle(Plane=top_of_the_pole, Radius=post_inside_rad)
cir_2 = Circle(Plane=top_of_the_pole, Radius=post_outside_rad)
Z = UnitZ(Factor=pole_length)
rdiff = RegionDifference(CurvesA=cir_2, CurvesB=cir)
extr = Extrude(Base=rdiff, Direction=Z)

tube_wall_thickness = Slider(3, range=0..10)
mirror_diameter = Slider(64, range=40..100)
lens_tube_height = Slider(154, range=40..200)
mirror_offset = Slider(154.3, range=-1..300)
tube_radius = Slider(40.9, range=0..100)
pt = Point(<point referenced from the Rhino model>)
xy = XYPlane(Origin=pt)

# ---- group: pi recess
crv = Curve([<curve referenced from the Rhino model> x4])
Z_2 = UnitZ(Factor=baseplugheight)
move = Move(Geometry=crv, Motion=Z_2)  # -> Geometry, Transform
Z_3 = UnitZ(Factor=expr("-x", pi_recess_depth))
boundary = BoundarySurfaces(Edges=move.Geometry)
extr_2 = Extrude(Base=boundary, Direction=Z_3)
sunion = SolidUnion(Breps=extr_2)

# ---- group: port holes
crv_2 = Curve([<curve referenced from the Rhino model> x3])
Z_4 = UnitZ(Factor=through_cut)
boundary_2 = BoundarySurfaces(Edges=crv_2)
extr_3 = Extrude(Base=boundary_2, Direction=Z_4)

# ---- group: base plug mass
subtraction = Subtraction(A=tube_radius, B=tube_wall_thickness)
cir_3 = Circle(Plane=PlaneXY(0, 0, 0), Radius=subtraction)
boundary_3 = BoundarySurfaces(Edges=cir_3)
Z_5 = UnitZ(Factor=baseplugheight)
extr_4 = Extrude(Base=boundary_3, Direction=Z_5)

# ---- group: cutter
boundary_4 = BoundarySurfaces(Edges=cir)
boundary_5 = BoundarySurfaces(Edges=cir_2)
extr_5 = Extrude(Base=boundary_4, Direction=expr("-x", Z))
extr_6 = Extrude(Base=boundary_5, Direction=Z)
sunion_2 = SolidUnion(Breps=[extr_6, extr_5])

# ---- group: Overall tube
tube = Tube(thickness=tube_wall_thickness, od=tube_radius, height=lens_tube_height, pln=xy)

# ----
pl_offset = PlaneOffset(BasePlane=xy, Offset=mirror_offset)
mirror_diameter_2 = Number(expr("x/2", mirror_diameter))
cir_4 = Circle(Plane=pl_offset, Radius=mirror_diameter_2)
sph = Sphere(Base=pl_offset, Radius=mirror_diameter_2)
Z_6 = UnitZ(Factor=mirror_diameter_2)
boundary_6 = BoundarySurfaces(Edges=cir_4)
extr_7 = Extrude(Base=boundary_6, Direction=Z_6)
sdiff = SolidDifference(BrepsA=sph, BrepsB=extr_7)

lens_tube = Geometry(tube)
reflector = Geometry(sdiff)

pole = Geometry(extr)

# ----
# Cam suport rods
number_slider = Slider(1.3, range=0..2)
number_slider_2 = Slider(3.3, range=0..10)
subtraction_2 = Subtraction(A=subtraction, B=number_slider_2)
off_deck = Slider(2, range=0..10)
polygon = Polygon(Plane=PlaneXY(0, 0, 0), Radius=subtraction_2, Segments=3, FilletRadius=0)  # -> Polygon, Length
disc = Discontinuity(Curve=polygon.Polygon, Level=1)  # -> Points, Parameters
subtraction_3 = Subtraction(A=number_slider_2, B=number_slider)
pin_radius = Panel(subtraction_3)
cir_5 = Circle(Plane=disc.Points, Radius=subtraction_3)
Z_7 = UnitZ(Factor=off_deck)
move_2 = Move(Geometry=cir_5, Motion=Z_7)  # -> Geometry, Transform
boundary_7 = BoundarySurfaces(Edges=move_2.Geometry)

# ----
# Camera Top cap
cam_lens_radius = Slider(4, range=3..10)
number_slider_3 = Slider(117, range=0..1000)
addition = Addition(A=number_slider_3, B=Slider(4, range=0..10))
subtraction_4 = Subtraction(A=tube_radius, B=tube_wall_thickness)
cir_6 = Circle(Plane=PlaneXY(0, 0, 0), Radius=subtraction_4)
Z_8 = UnitZ(Factor=number_slider_3)
move_3 = Move(Geometry=cir_6, Motion=Z_8)  # -> Geometry, Transform
Z_9 = UnitZ(Factor=Slider(10, range=0..100))  # -> expr("-x", UnitVector)
Z_10 = UnitZ(Factor=Slider(2, range=0..100))  # -> expr("-x", UnitVector)
boundary_8 = BoundarySurfaces(Edges=move_3.Geometry)
extr_8 = Extrude(Base=boundary_8, Direction=Z_9)
extr_9 = Extrude(Base=boundary_8, Direction=Z_10)

# ---- group: cam pins
shoulder_height = Slider(6, range=0..10)
# Support pole
number_slider_4 = Slider(3, range=0..10)
Z_11 = UnitZ(Factor=addition)
pt_2 = Point([<point referenced from the Rhino model> x4])
move_4 = Move(Geometry=pt_2, Motion=Z_11)  # -> Geometry, Transform
cir_7 = Circle(Plane=move_4.Geometry, Radius=Slider(1.5, range=0..10))
cir_8 = Circle(Plane=move_4.Geometry, Radius=Slider(0.6, range=0..10))
boundary_9 = BoundarySurfaces(Edges=cir_7)
boundary_10 = BoundarySurfaces(Edges=cir_8)
addition_2 = Addition(A=shoulder_height, B=number_slider_4)
Z_12 = UnitZ(Factor=shoulder_height)  # -> expr("-x", UnitVector)
Z_13 = UnitZ(Factor=addition_2)  # -> expr("-x", UnitVector)
extr_10 = Extrude(Base=boundary_10, Direction=Z_13)
extr_11 = Extrude(Base=boundary_9, Direction=Z_12)
sunion_3 = SolidUnion(Breps=[extr_11, extr_10])

# ---- group: lens hole
cir_9 = Circle(Plane=PlaneXY(0, 0, 0), Radius=cam_lens_radius)
Z_14 = UnitZ(Factor=200)
boundary_11 = BoundarySurfaces(Edges=cir_9)
extr_12 = Extrude(Base=boundary_11, Direction=Z_14)

# ----
Z_15 = UnitZ(Factor=number_slider_3)
extr_13 = Extrude(Base=boundary_7, Direction=Z_15)
brep = Brep(extr_13)

sdiff_2 = SolidDifference(BrepsA=extr_9, BrepsB=extr_12)
sunion_4 = SolidUnion(Breps=[sdiff_2, sunion_3])
sdiff_3 = SolidDifference(BrepsA=extr_8, BrepsB=extr_13)

sdiff_4 = SolidDifference(BrepsA=extr_4, BrepsB=sunion_2)
sdiff_5 = SolidDifference(BrepsA=sdiff_4, BrepsB=brep)
sdiff_6 = SolidDifference(BrepsA=sdiff_5, BrepsB=sunion)
sdiff_7 = SolidDifference(BrepsA=sdiff_6, BrepsB=extr_3)
sdiff_8 = SolidDifference(BrepsA=sdiff_7, BrepsB=extr)

sdiff_9 = SolidDifference(BrepsA=sunion_4, BrepsB=extr_12)
geo = Geometry([sdiff_9, sdiff_3])
debrep = DeconstructBrep(Brep=sdiff_8)  # -> Faces, Edges, Vertices
camera_plug = Geometry(geo)
base_plug = Geometry(sdiff_8)
merge = Merge(Data1=camera_plug, Data3=reflector, Data4=lens_tube, Data5=base_plug, Data6=pole)

# ==== cluster Tube
thickness = ClusterInput()
od = ClusterInput()
height = ClusterInput()
pln = ClusterInput()
thickness_2 = Number(thickness)
od_2 = Number(od)
height_2 = Number(height)
pln_2 = Plane(pln)
subtraction = Subtraction(A=od_2, B=thickness_2)
cir = Circle(Plane=pln_2, Radius=subtraction)
cir_2 = Circle(Plane=pln_2, Radius=od_2)
Z = UnitZ(Factor=height_2)
boundary = BoundarySurfaces(Edges=[cir, cir_2])
extr = Extrude(Base=boundary, Direction=Z)
capex = CapHolesEx(Brep=extr)  # -> Brep, Caps, Solid
tube = Brep(capex.Brep)
tube_2 = ClusterOutput(tube)
